# Grasshopper definition TTC_Workflow_V1.gh (Grasshopper 1.0.8)
# plug-ins: Karamba3D

assemble = AssembleModelKaramba3D(LimitDistance_m=0.005)  # -> Model, Info, Mass_kg, CentreOfGravity, LoadCaseNames
analyse = AnalyseKaramba3D(Model=assemble.Model)  # -> AnalysedModel, MaximumDisplacement_cm, ResultingForce_kN, ChangeOfElasticEnergy_kNm
modelview = ModelViewKaramba3D(Model=analyse.AnalysedModel)  # -> Model, DeformedMesh, DeformedAxes, DeformedModel, MaximumDeformation
beamview = BeamViewKaramba3D(Model=modelview.Model)  # -> Model, MeshesOfRenderedBeams, DeformedBeamAxes, LegendColours, LegendTags
legend = LegendKaramba3D(
    Colors=beamview.LegendColours,
    Tags=beamview.LegendTags,
    Scale=0.8,
    Textsize=30,
    Legend_HasHeader=False,
    Legend_Justification=2,
    Legend_Position=2)
